# Grasshopper definition A2.gh (Grasshopper 1.0.7)

number_slider = Slider(0.395, range=0..1)
number_slider_2 = Slider(0.136, range=0..1)
point = Point(Point(9.642170997, 0.9337871303, 0))
point_2 = Point(Point(10.357829, 0.9337871303, 0))
plane = Plane(PlaneXY(10, 0, 0))
line = Line(StartPoint=point, EndPoint=point_2)
division = Division(A=number_slider_2, B=Slider(-2, range=-10..10))
subtraction = Subtraction(A=Slider(1, range=-10..10), B=number_slider)
rectangle = Rectangle(Plane=plane, XSize=number_slider_2, YSize=number_slider, Radius=0)  # -> Rectangle, Length
circle = Circle(Plane=plane, Radius=Slider(1, range=-0.001..2))
vector_xyz = VectorXYZ(XComponent=division, YComponent=subtraction, ZComponent=0)  # -> Vector, Length
polar_array = PolarArray(Geometry=line, Plane=plane, Count=Slider(8, range=0..10), Angle=6.283185307)  # -> flatten(Geometry), Transform
length = Length(Curve=line)
move = Move(Geometry=rectangle.Rectangle, Motion=vector_xyz.Vector)  # -> Geometry, Transform
curve_middle = CurveMiddle(Curve=polar_array.Geometry)
division_2 = Division(A=length, B=Slider(2, range=0..10))
polar_array_2 = PolarArray(Geometry=move.Geometry, Plane=plane, Count=Slider(8, range=0..10), Angle=6.283185307)  # -> Geometry, Transform
circle_2 = Circle(Plane=curve_middle, Radius=division_2)
trim_with_regions = TrimWithRegions(Curve=circle, Regions=circle_2)  # -> Inside, flatten(Outside)
curve = Curve(trim_with_regions.Outside)
join_curves = JoinCurves(Curves=[polar_array.Geometry, curve], Preserve=False)  # -> flatten(Curves)
trim_with_regions_2 = TrimWithRegions(Curve=join_curves, Regions=polar_array_2.Geometry)  # -> Inside, flatten(Outside)
trim_with_regions_3 = TrimWithRegions(Curve=polar_array_2.Geometry, Regions=join_curves, Plane=polar_array.Geometry)  # -> Inside, flatten(Outside)
curve_2 = Curve(join_curves)
join_curves_2 = JoinCurves(Curves=[trim_with_regions_2.Outside, trim_with_regions_3.Inside], Preserve=False)
curve_3 = Curve(trim_with_regions_3.Inside)
curve_4 = Curve(trim_with_regions_2.Outside)
